# Grasshopper definition Astar_main.gh (Grasshopper 1.0.7)
# Copyright: Job de Vogel
# plug-ins: Kangaroo Components

old_v1 = GhPythonScript()  # -> a; inputs x: Int32, y: Int32, z: Int32, x_dis: Int32, y_dis: Int32, z_dis: Int32, index: Int32
# ---------- old_v1: Python ----------
__author__ = "Job de Vogel"
__version__ = "2020.11.07"

from math import sqrt

indices = [i for i in range(x * y * z)]
rectangular = True
diagonal = True
corners = True
graph = {}

length = x * y * z #this value should be global! Only calculate it once!

def pythagoras(x, y, z = 0):
    return sqrt(x**2 + y**2 + z**2)

#statements
def neighbors(i):
    nb = {}

    st1 = st2 = st3 = st4 = st5 = st6 = False 

    if i % z == 0: st1 = True #bottum --> [i - 1]
    if i % z == z - 1: st2 = True #top --> [i + 1]
    if i < (y * z): st3 = True #left --> [i - (y * z)]
    if i >= (length - (y * z)): st4 = True #right --> [i + (y * z)]
    if ((i % (y * z)) < z): st5 = True # front --> [i - z]]
    if ((i % (y * z)) >= (y * z) - z): st6 = True # back

    #This order decides the prevered children
    if rectangular:
        if st1 == False: nb[i - 1] = z_dis
        if st2 == False: nb[i + 1] = z_dis
        if st3 == False: nb[i - (y * z)] = x_dis
        if st4 == False: nb[i + (y * z)] = x_dis
        if st5 == False: nb[i - z] = y_dis
        if st6 == False: nb[i + z] = y_dis

    if diagonal:
        #CALCULATE PYTHAGORAS HERE OR, EVEN BETTER, ABOVE THE FUNCTION
        if st1 == False and st3 == False: nb[i - (y * z) - 1] = pythagoras(x_dis, z_dis)
        if st1 == False and st4 == False: nb[i + (y * z) - 1] = pythagoras(x_dis, z_dis)
        if st1 == False and st5 == False: nb[i - z - 1] = pythagoras(y_dis, z_dis)
        if st1 == False and st6 == False: nb[i + z - 1] = pythagoras(y_dis, z_dis)
        if st2 == False and st3 == False: nb[i - (y * z) + 1] = pythagoras(x_dis, z_dis)
        if st2 == False and st4 == False: nb[i + (y * z) + 1] = pythagoras(x_dis, z_dis)
        if st2 == False and st5 == False: nb[i - z + 1] = pythagoras(y_dis, z_dis)
        if st2 == False and st6 == False: nb[i + z + 1] = pythagoras(y_dis, z_dis)
        if st3 == False and st5 == False: nb[i - (y * z) - z] = pythagoras(x_dis, y_dis)
        if st3 == False and st6 == False: nb[i - (y * z) + z] = pythagoras(x_dis, y_dis)
        if st4 == False and st5 == False: nb[i + (y * z) - z] = pythagoras(x_dis, y_dis)
        if st4 == False and st6 == False: nb[i + (y * z) + z] = pythagoras(x_dis, y_dis)
    
    if corners:
        t_dis = pythagoras(x_dis, y_dis, z_dis)
        if st2 == st4 == st6 == False:
            nb[i + (y * z) + z + 1] = t_dis
        if st1 == st4 == st6 == False:
            nb[i + (y * z) + z - 1] = t_dis
        if st2 == st4 == st5 == False:
            nb[i + (y * z) - z + 1] = t_dis
        if st1 == st4 == st5 == False:
            nb[i + (y * z) - z - 1] = t_dis
        if st2 == st3 == st6 == False:
            nb[i - (y * z) + z + 1] = t_dis
        if st1 == st3 == st6 == False:
            nb[i - (y * z) + z - 1] = t_dis
        if st2 == st3 == st5 == False:
            nb[i - (y * z) - z + 1] = t_dis
        if st1 == st3 == st5 == False:
            nb[i - (y * z) - z - 1] = t_dis
    return nb.keys()

#TESTED WITH i = 31
#CHECK IF A FUNCTION WORKS FASTER THAN APPENDING GRAHP[I] = NB
#USING DICTIONARIES SHOULD BE TWICE FASTER THAN IF STATEMENTS

a = neighbors(index)

"""
a = {}
for i in indices:
    a[i] = neighbors(i)
### --- DO NOT PRINT THIS --- ###
"""
# ---------- end old_v1 ----------
old_v2 = GhPythonScript()  # -> a
# ---------- old_v2: Python ----------
from math import sqrt

x = 20
y = 20
z = 20


indices = [i for i in range(x * y * z)]
rectangular = True
diagonal = True
corners = True
graph = {}

length = x * y * z #this value should be global! Only calculate it once!

def pythagoras(x, y, z = 0):
    return sqrt(x**2 + y**2 + z**2)

#statements
def neighbors(i):
    nb = {}

    x_dis = 1
    y_dis = 1
    z_dis = 1

    st1 = st2 = st3 = st4 = st5 = st6 = False 

    if i % z == 0: st1 = True #bottum --> [i - 1]
    if i % z == z - 1: st2 = True #top --> [i + 1]
    if i < (y * z): st3 = True #left --> [i - (y * z)]
    if i >= (length - (y * z)): st4 = True #right --> [i + (y * z)]
    if ((i % (y * z)) < z): st5 = True # front --> [i - z]]
    if ((i % (y * z)) >= (y * z) - z): st6 = True # back

    #This order decides the prevered children
    if rectangular:
        if st1 == False: nb[i - 1] = z_dis
        if st2 == False: nb[i + 1] = z_dis
        if st3 == False: nb[i - (y * z)] = x_dis
        if st4 == False: nb[i + (y * z)] = x_dis
        if st5 == False: nb[i - z] = y_dis
        if st6 == False: nb[i + z] = y_dis

    if diagonal:
        #CALCULATE PYTHAGORAS HERE OR, EVEN BETTER, ABOVE THE FUNCTION
        if st1 == False and st3 == False: nb[i - (y * z) - 1] = pythagoras(x_dis, z_dis)
        if st1 == False and st4 == False: nb[i + (y * z) - 1] = pythagoras(x_dis, z_dis)
        if st1 == False and st5 == False: nb[i - z - 1] = pythagoras(y_dis, z_dis)
        if st1 == False and st6 == False: nb[i + z - 1] = pythagoras(y_dis, z_dis)
        if st2 == False and st3 == False: nb[i - (y * z) + 1] = pythagoras(x_dis, z_dis)
        if st2 == False and st4 == False: nb[i + (y * z) + 1] = pythagoras(x_dis, z_dis)
        if st2 == False and st5 == False: nb[i - z + 1] = pythagoras(y_dis, z_dis)
        if st2 == False and st6 == False: nb[i + z + 1] = pythagoras(y_dis, z_dis)
        if st3 == False and st5 == False: nb[i - (y * z) - z] = pythagoras(x_dis, y_dis)
        if st3 == False and st6 == False: nb[i - (y * z) + z] = pythagoras(x_dis, y_dis)
        if st4 == False and st5 == False: nb[i + (y * z) - z] = pythagoras(x_dis, y_dis)
        if st4 == False and st6 == False: nb[i + (y * z) + z] = pythagoras(x_dis, y_dis)
    
    if corners:
        t_dis = pythagoras(x_dis, y_dis, z_dis)
        if st2 == st4 == st6 == False:
            nb[i + (y * z) + z + 1] = t_dis
        if st1 == st4 == st6 == False:
            nb[i + (y * z) + z - 1] = t_dis
        if st2 == st4 == st5 == False:
            nb[i + (y * z) - z + 1] = t_dis
        if st1 == st4 == st5 == False:
            nb[i + (y * z) - z - 1] = t_dis
        if st2 == st3 == st6 == False:
            nb[i - (y * z) + z + 1] = t_dis
        if st1 == st3 == st6 == False:
            nb[i - (y * z) + z - 1] = t_dis
        if st2 == st3 == st5 == False:
            nb[i - (y * z) - z + 1] = t_dis
        if st1 == st3 == st5 == False:
            nb[i - (y * z) - z - 1] = t_dis
    return nb.keys()

def graph(indices):
    graph = {}
    
    for i in indices:
        graph[i] = neighbors(i)
    
    return graph

GRAPH = False
i = 1

def main():
    if GRAPH:
        graph(indices)
    else:
        neighbors(i)

main()
# ---------- end old_v2 ----------
old_v3 = GhPythonScript()  # -> out, a
# ---------- old_v3: Python ----------
__author__ = "Job de Vogel"
__version__ = "2020.11.14"

# -*- coding: utf-8 -*-
"""
Created on Sat Nov 14 22:20:04 2020

@author: Job de Vogel
"""

import math
x = 20
y = 20
z = 20

indices = [i for i in range(x * y * z)]
rectangular =  True
diagonal = False
corners = False
graph = {}

x_dis = 1
y_dis = 1
z_dis = 1

length = x * y * z #this value should be global! Only calculate it once!

def pythagoras(x, y, z = 0):
    return math.sqrt(x**2 + y**2 + z**2)

#statements
def neighbors(i):
    nb = {}

    st1 = st2 = st3 = st4 = st5 = st6 = False 

    if i % z == 0: st1 = True #bottum --> [i - 1]
    if i % z == z - 1: st2 = True #top --> [i + 1]
    if i < (y * z): st3 = True #left --> [i - (y * z)]
    if i >= (length - (y * z)): st4 = True #right --> [i + (y * z)]
    if ((i % (y * z)) < z): st5 = True # front --> [i - z]]
    if ((i % (y * z)) >= (y * z) - z): st6 = True # back

    #This order decides the prevered children
    if rectangular:
        if st1 == False: nb[i - 1] = z_dis
        if st2 == False: nb[i + 1] = z_dis
        if st3 == False: nb[i - (y * z)] = x_dis
        if st4 == False: nb[i + (y * z)] = x_dis
        if st5 == False: nb[i - z] = y_dis
        if st6 == False: nb[i + z] = y_dis

    if diagonal:
        #6: i - y * z - 1 (mag als: st1 == False, st3 == False)
        if st1 == False and st3 == False: nb[i - (y * z) - 1] = pythagoras(x_dis, z_dis)
        
        #54: i + y * z - 1 (mag als: st1 == False, st4 == False)
        if st1 == False and st4 == False: nb[i + (y * z) - 1] = pythagoras(x_dis, z_dis)
            
        #24: i - 1 - z (mag als: st1 == False, st5 == False)
        if st1 == False and st5 == False: nb[i - z - 1] = pythagoras(y_dis, z_dis)
        
        #36: i - 1 + z (mag als: st1 == False, st6 == False)
        if st1 == False and st6 == False: nb[i + z - 1] = pythagoras(y_dis, z_dis)
        
        #8: i - y * z + 1 (mag als: st2 == False, st3 == False)
        if st2 == False and st3 == False: nb[i - (y * z) + 1] = pythagoras(x_dis, z_dis)
        
        #56: i + y * z + 1 (mag als: st2 == False, st4 == False)
        if st2 == False and st4 == False: nb[i + (y * z) + 1] = pythagoras(x_dis, z_dis)
        
        #26: i + 1 - z (mag als: st2 == False, st5 == False)
        if st2 == False and st5 == False: nb[i - z + 1] = pythagoras(y_dis, z_dis)
        
        #38: i  + 1 + z (mag als: st2 == False, st6 == False)
        if st2 == False and st6 == False: nb[i + z + 1] = pythagoras(y_dis, z_dis)
        
        #1:  i - y * z - z (mag als: st3 == False, st5 == False)
        if st3 == False and st5 == False: nb[i - (y * z) - z] = pythagoras(x_dis, y_dis)
        
        #13: i - y * z + z (mag als: st3 == False, st6 == False)
        if st3 == False and st6 == False: nb[i - (y * z) + z] = pythagoras(x_dis, y_dis)
        
        #49: i + y * z - z (mag als: st4 == False, st5 == False)
        if st4 == False and st5 == False: nb[i + (y * z) - z] = pythagoras(x_dis, y_dis)
        
        #61: i + y * z + z (mag als: st4 == False, st6 == False)
        if st4 == False and st6 == False: nb[i + (y * z) + z] = pythagoras(x_dis, y_dis)
    
    if corners:
        t_dis = pythagoras(x_dis, y_dis, z_dis)
        if st2 == st4 == st6 == False:
            #nb[i  (y * z) - z - 1] = t_dis
            nb[i + (y * z) + z + 1] = t_dis
        if st1 == st4 == st6 == False:
            #nb[i - (y * z) - z + 1] = t_dis
            nb[i + (y * z) + z - 1] = t_dis
        if st2 == st4 == st5 == False:
            #nb[i - (y * z) + z - 1] = t_dis
            nb[i + (y * z) - z + 1] = t_dis
        if st1 == st4 == st5 == False:
            #nb[i - (y * z) + z + 1] = t_dis
            nb[i + (y * z) - z - 1] = t_dis
        if st2 == st3 == st6 == False:
            #nb[i + (y * z) - z - 1] = t_dis
            nb[i - (y * z) + z + 1] = t_dis
        if st1 == st3 == st6 == False:
            #nb[i + (y * z) - z + 1] = t_dis
            nb[i - (y * z) + z - 1] = t_dis
        if st2 == st3 == st5 == False:
            #nb[i + (y * z) + z - 1] = t_dis
            nb[i - (y * z) - z + 1] = t_dis
        if st1 == st3 == st5 == False:
            #nb[i + (y * z) + z + 1] = t_dis
            nb[i - (y * z) - z - 1] = t_dis
    return nb

#TESTED WITH i = 31
neighbors(0)
# ---------- end old_v3 ----------
ghpython_script = GhPythonScript()  # -> out, a
# ---------- ghpython_script: Python ----------
__author__ = "Job de Vogel"
__version__ = "2020.11.16"

import rhinoscriptsyntax as rs
import math

x = 5
y = 5
z = 5
x_dis = 1
y_dis = 2
z_dis = 3

def manhattan(ptnum1, ptnum2):
    x_manhattan = abs(int((ptnum2 // y) * x_dis))
    y_manhattan = abs(int(n % z) * y_dis)
    return x_manhattan + y_manhattan + z_manhattan


n = 5
x_m = int((n // (y * z)) * x_dis)
y_m = int((n % z) * y_dis)
z_m = n % (z + 1)
# ---------- end ghpython_script ----------
graph = GhPythonScript(Type=2, Graph=True)  # -> Neighbors; inputs Index: Int32, x: Int32, y: Int32, z: Int32, Type: Int32, Graph: Boolean, Cull_Data: list
# ---------- graph: Python ----------
import array as array

cloud_size = x * y * z

indices = array.array('i', [i for i in range(cloud_size)])

bottum = array.array('i', [])
top = array.array('i', [])
left = array.array('i', [])
right = array.array('i', [])
front = array.array('i', [])
back = array.array('i', [])

bottum = top = left = right = front = back = False

for i in indices:
    if i % z == 0:
        bottum.append(i)
        bottum = True
    elif i % z == z - 1:
        top.append(i)
        top = True
    if i < (y * z):
        left.append(i)
        left = True
    elif i >= (cloud_size - (y * z)):
        right.append(i)
        right = True
    if (i % (y * z)) < z:
        front.append(i)
        front = True
    elif (i % (y * z)) >= (y * z) - z:
        back.append(i)
        back = True

dict_bottum = {}
for index in bottum:
    dict_bottum[] = 

dict_bottum = {0 : {1, 2, 3, 4}}
dict_top = {0 : {2, 3, 4, 5}}
dict_bottum.add(dict_top)
print(dict_bottum)

#Calculate all neighbors for all sides
#
#Combine all sides, including center together
# ---------- end graph ----------
astar_algorithm_massive = GhPythonScript()  # -> result; inputs x: Int32, y: Int32, z: Int32, StartIndex: list of Int32, GoalIndex: list of Int32, Seeds: list of Int32, manhattanDistance: Boolean; disabled
# ---------- astar_algorithm_massive: Python ----------
__author__ = "Job de Vogel"
__version__ = "2020.11.06"

from math import sqrt
import copy
import array as array
import random

#Grasshopper to Python variables:
cloud_size = x * y * z
Graph = eval(Graph)
StartIndex = StartIndex
GoalIndex = GoalIndex

for i in range(len(StartIndex)):
    if StartIndex[i] >= cloud_size:
        StartIndex[i] %= cloud_size

for j in range(len(GoalIndex)):
    if GoalIndex[j] >= cloud_size:
        GoalIndex[j] %= cloud_size

def manhattan(index_1, index_2):
    x_manhattan = abs(((index_2 // (y * z)) - (index_1 // (y * z)))) * x_dis
    y_manhattan = abs(((index_2 % (y * z)) // z) - ((index_1 % (y * z)) // z)) * y_dis
    z_manhattan = abs((index_2 % z - index_1 % z)) * z_dis
    return x_manhattan + y_manhattan + z_manhattan

def euclidian(index_1, index_2):
    x_manhattan = abs(((index_2 // (y * z)) - (index_1 // (y * z)))) * x_dis
    y_manhattan = abs(((index_2 % (y * z)) // z) - ((index_1 % (y * z)) // z)) * y_dis
    z_manhattan = abs((index_2 % z - index_1 % z)) * z_dis
    return sqrt(x_manhattan**2 + y_manhattan**2 + z_manhattan**2)

def algorithm(Graph, Start, Goal, manhattanDistance = True):
    ###variables:
    open_set = []
    open_set.append((0, Start))
    came_from = {}
    path = array.array('i', [])
    #INTEGRATE A SEED GENERATOR HERE WITH RANDOM.SAMPLE, REFERENCE SHUFFLE TO RANDOM.SAMPLE[CURRENT]

    g_score = {index: float("inf") for index in range(cloud_size)}
    g_score[Start] = 0
    
    f_score = {index: float("inf") for index in range(cloud_size)}
    
    if manhattanDistance:
        f_score[Start] = manhattan(Start, Goal)
    else:
        f_score[Start] = euclidian(Start, Goal)
    
    closed_set = {Start}
    #Algorithm function:
    while open_set:
        current = open_set[0][1]
        closed_set.remove(current)
    
        if current == Goal:
            #rebuild the path:
            while current != Start:
                    try:
                        path.insert(0, current)
                        current = came_from[current]
                    except KeyError:
                        path = False
                        break
            path.insert(0, Start)
            break
        
        Neighbors = []
        iteration = 1
        for neighbor in Graph[current]:
            print(neighbor)
            temp_g_score = g_score[current] + Graph[current][neighbor]
            if temp_g_score < g_score[neighbor]:
                came_from[neighbor] = current
                g_score[neighbor] = temp_g_score
                
                if manhattanDistance:
                    f_score[neighbor] = temp_g_score + manhattan(neighbor, Goal)
                else:
                    f_score[neighbor] = temp_g_score + euclidian(neighbor, Goal) 
                
                if neighbor not in closed_set:
                    Neighbors.append((f_score[neighbor], neighbor))
                    closed_set.add(neighbor)
        #if Seeds:
            #random.seed(Seeds[current])
        #random.shuffle(Neighbors)
        open_set = open_set + Neighbors
        
        #sort open_set based on f_score
        open_set.pop(0)
        open_set = sorted(open_set, key = lambda f: f[0])
        
        iteration += 1
    print(iteration)
    return path

def main(i):
    #Check if there are multiple starts/goals, if not use a single value
    if len(StartIndex) > 1:
        Start = StartIndex[i]
    else:
        Start = StartIndex[0]

    if len(GoalIndex) > 1:
        Goal = GoalIndex[i]
    else:
        Goal = GoalIndex[0]

    #Try to find a path, if not possible, return empty list
    try:
        path = algorithm(Graph, Start, Goal, manhattanDistance)
    except:
        path = None

    return path

iterations = [j for j in range(len(StartIndex))]

import ghpythonlib.parallel as parallel
import ghpythonlib.treehelpers as th

result = th.list_to_tree(parallel.run(main, iterations, False))
# ---------- end astar_algorithm_massive ----------
graph_2 = GhPythonScript(Type=2, Graph=True)  # -> Neighbors; inputs Index: Int32, x: Int32, y: Int32, z: Int32, Type: Int32, Graph: Boolean, Cull_Data: list; disabled
# ---------- graph_2: Python ----------
from math import sqrt
import array as array

#global variables
cloud_size = x * y * z
rectangular = False
diagonal = False
corners = False

Cull_Data = set(Cull_Data)

if Index >= cloud_size:
    Index %= cloud_size

###grasshopper variables
if Type == 0:
    rectangular = True
elif Type == 1:
    rectangular = True
    diagonal = True
elif Type == 2:
    rectangular = True
    diagonal = True
    corners = True


#Pythagoras definition
def pythagoras(x, y, z = 0):
    return sqrt(x**2 + y**2 + z**2)

#If diagonal: calculate the diagonal distances
if diagonal:
    xy_dis = pythagoras(x_dis, y_dis)
    xz_dis = pythagoras(x_dis, z_dis)
    yz_dis = pythagoras(y_dis, z_dis)  

#If corners: calculate the corner distances
if corners:
    t_dis = pythagoras(x_dis, y_dis, z_dis)

#Generate an array with all
indices = array.array('i', [i for i in range(cloud_size)])

#This variable will store the final graph with the neighbors
graph = {}

def neighbors(i):
    nb = {}
    bottum = top = left = right = front = back = False 

    if i % z == 0: 
        bottum = True # --> [i - 1]
    if i % z == z - 1: 
        top = True #top --> [i + 1]
    if i < (y * z): 
        left = True #left --> [i - (y * z)]
    if i >= (cloud_size - (y * z)): 
        right = True #right --> [i + (y * z)]
    if ((i % (y * z)) < z): 
        front = True # front --> [i - z]]
    if ((i % (y * z)) >= (y * z) - z): 
        back = True # back

    #if in center:
    if (bottum == top == left == right == front == back == False):
        if rectangular:
            #nb_indices: the indices of all possible neighbors of a node
            #distances: the distances to each possible neighbor in order of nb_indices
            nb_indices = array.array('i', [i - (y * z), i + (y * z), i - z, i + z, i - 1, i + 1])
            distances = array.array('f', [x_dis, x_dis, y_dis, y_dis, z_dis, z_dis])

            #for each possible neighbor, if not in Cull_Data, add it to the final neighbors with the correct distance
            for j in range(len(nb_indices)):
                if nb_indices[j] not in Cull_Data:
                    nb[nb_indices[j]] = distances[j]

        if diagonal:
            #nb_indices: the indices of all possible neighbors of a node
            #distances: the distances to each possible neighbor in order of nb_indices
            nb_indices = array.array('i', [i - (y * z) - 1, i + (y * z) - 1, i - z - 1, i + z - 1, i - (y * z) + 1, i + (y * z) + 1, i - z + 1, i + z + 1, i - (y * z) - z, i - (y * z) + z, i + (y * z) - z, i + (y * z) + z])
            distances = array.array('f', [xz_dis, xz_dis, yz_dis, yz_dis, xz_dis, xz_dis, yz_dis, yz_dis, xy_dis, xy_dis, xy_dis, xy_dis])
            
            #for each possible neighbor, if not in Cull_Data, add it to the final neighbors with the correct distance
            for j in range(len(nb_indices)):
                if nb_indices[j] not in Cull_Data:
                    nb[nb_indices[j]] = distances[j]
        if corners:
            #nb_indices: the indices of all possible neighbors of a node
            nb_indices = array.array('i', [i + (y * z) + z + 1, i + (y * z) + z - 1, i + (y * z) - z + 1, i + (y * z) - z - 1, i + (y * z) - z - 1, i - (y * z) + z - 1, i - (y * z) - z + 1, i - (y * z) - z - 1])
            #for each possible neighbor, if not in Cull_Data, add it to the final neighbors with the correct distance
            for j in range(len(nb_indices)):
                if nb_indices[j] not in Cull_Data:
                    nb[nb_indices[j]] = t_dis
    #if not in center, check on which edges:
    else:
        if rectangular:
            #nb_indices: the indices of all possible neighbors of a node
            #distances: the distances to each possible neighbor in order of nb_indices
            #edges: edge to check for every neigbor, if neighbor not on that edge, add the neighbor to the node
            nb_indices = array.array('i', [i - (y * z), i + (y * z), i - z, i + z, i - 1, i + 1])
            distances = array.array('f', [x_dis, x_dis, y_dis, y_dis, z_dis, z_dis])
            edges = [left, right, front, back, bottum, top]
            
            #for each possible neighbor, if not in Cull_Data, add it to the final neighbors with the correct distance
            for j in range(len(nb_indices)):
                if nb_indices[j] not in Cull_Data and not edges[j]:
                    nb[nb_indices[j]] = distances[j]

        if diagonal:
            #nb_indices: the indices of all possible neighbors of a node
            #distances: the distances to each possible neighbor in order of nb_indices
            #edges: edge to check for every neigbor, if neighbor not on that edge, add the neighbor to the node
            nb_indices = array.array('i', [i - (y * z) - 1, i + (y * z) - 1, i - z - 1, i + z - 1, i - (y * z) + 1, i + (y * z) + 1, i - z + 1, i + z + 1, i - (y * z) - z, i - (y * z) + z, i + (y * z) - z, i + (y * z) + z])
            distances = array.array('f', [xz_dis, xz_dis, yz_dis, yz_dis, xz_dis, xz_dis, yz_dis, yz_dis, xy_dis, xy_dis, xy_dis, xy_dis])
            edges = [bottum|left, bottum|right, bottum|front, bottum|back, top|left, top|right, top|front, top|back, left|front, left|back, right|front, right|back]
            #for each possible neighbor, if not in Cull_Data, add it to the final neighbors with the correct distance
            for j in range(len(nb_indices)):
                if nb_indices[j] not in Cull_Data and not edges[j]:
                    nb[nb_indices[j]] = distances[j]

        if corners:
            #nb_indices: the indices of all possible neighbors of a node
            #edges: edge to check for every neigbor, if neighbor not on that edge, add the neighbor to the node
            nb_indices = array.array('i', [i + (y * z) + z + 1, i + (y * z) + z - 1, i + (y * z) - z + 1, i + (y * z) - z - 1, i - (y * z) + z + 1, i - (y * z) + z - 1, i - (y * z) - z + 1, i - (y * z) - z - 1])
            edges = [top|right|back, bottum|right|back, top|right|front, bottum|right|front, top|left|back, bottum|left|back, top|left|front, bottum|left|front]
            #for each possible neighbor, if not in Cull_Data, add it to the final neighbors with the correct distance
            for j in range(len(nb_indices)):
                if nb_indices[j] not in Cull_Data and not edges[j]:
                    nb[nb_indices[j]] = t_dis
    return nb

def graph(indices):
    graph = {}
    
    Culled_indices = [i for i in indices if i not in Cull_Data]
    for i in Culled_indices:
        graph[i] = neighbors(i)
    
    return graph

i = Index
if i >= cloud_size:
    i %= cloud_size

def main():
    if Graph:
        return str(graph(indices))
    else:
        return neighbors(i)

Neighbors = main()
# ---------- end graph_2 ----------
building_brep = Brep([<brep referenced from the Rhino model> x4])

# ----
# BUILDING VISUALIZATION
number_slider = Slider(57, range=0..255)
number_slider_2 = Slider(126, range=0..255)
solid_union = SolidUnion(Breps=building_brep)
colour_rgb = ColourRGB(Alpha=number_slider, Red=number_slider_2, Green=number_slider_2, Blue=number_slider_2)
custom_preview = CustomPreview(Geometry=solid_union, Material=colour_rgb)  # disabled

# ----
# REMOVE DELETED RHINO GEOMETRY
null_item = NullItem(Item=building_brep)  # -> NullFlags, InvalidFlags, Description
cull_pattern = CullPattern(List=building_brep, CullPattern=invert(null_item.NullFlags))

# ----
# BUILDING GRID GENERATOR
# GENERATES A GRID FROM A UNION BOX AROUND BREP INPUT.
bounding_box = BoundingBox(Content=cull_pattern, Plane=PlaneXY(0, 0, 0), UnionBox=True)  # -> Box, Box_2
x_dis = Slider(1, range=0..10)
y_dis = Slider(1, range=0..10)
z_dis = Slider(1, range=0..10)
deconstruct_brep = DeconstructBrep(Brep=bounding_box.Box)  # -> Faces, Edges, Vertices
deconstruct_box = DeconstructBox(Box=bounding_box.Box)  # -> Plane, X, Y, Z
number = Number(deconstruct_box.X)
number_2 = Number(deconstruct_box.Y)
number_3 = Number(deconstruct_box.Z)
list_item = ListItem(List=deconstruct_brep.Vertices, Index=0, Wrap=True)
division = Division(A=number, B=x_dis)
division_2 = Division(A=number_2, B=y_dis)
division_3 = Division(A=number_3, B=z_dis)
center_box = CenterBox(Base=list_item, X=expr("x/2", x_dis), Y=expr("x/2", y_dis), Z=expr("x/2", z_dis))
round = Round(Number=division)  # -> Nearest, Floor, Ceiling
round_2 = Round(Number=division_2)  # -> Nearest, Floor, Ceiling
round_3 = Round(Number=division_3)  # -> Nearest, Floor, Ceiling
box_array = BoxArray(Geometry=list_item, Cell=center_box, XCount=round.Ceiling, YCount=round_2.Ceiling, ZCount=round_3.Ceiling)  # -> Geometry, Transform
x = Integer(round.Ceiling)
z = Integer(round_3.Ceiling)
y = Integer(round_2.Ceiling)
y_dis_2 = Integer(y_dis)
z_dis_2 = Integer(z_dis)
x_dis_2 = Integer(x_dis)
sort_points = SortPoints(Points=box_array.Geometry)  # -> Points, Indices
merge = Merge(Data1=x_dis_2, Data2=y_dis_2, Data3=z_dis_2)
merge_2 = Merge(Data1=x, Data2=y, Data3=z)
original_indices = Integer(sort_points.Indices)
original_points = Point(sort_points.Points)
grid_extend = Integer(merge_2)
grid_size = Integer(merge)

# ----
# GRID GENERATOR
x_2 = Slider(10, range=0..100)
y_2 = Slider(10, range=0..100)
z_2 = Slider(10, range=0..100)
x_distance = Slider(4, range=0..10)
y_distance = Slider(4, range=0..10)
z_distance = Slider(4, range=0..10)
center_box_2 = CenterBox(Base=PlaneXY(0, 0, 0), X=expr("x/2", x_distance), Y=expr("x/2", y_distance), Z=expr("x/2", z_distance))
construct_point = ConstructPoint(XCoordinate=0, YCoordinate=0, ZCoordinate=0)
box_array_2 = BoxArray(Geometry=construct_point, Cell=center_box_2, XCount=x_2, YCount=y_2, ZCount=z_2)  # -> Geometry, Transform
sort_points_2 = SortPoints(Points=box_array_2.Geometry)  # -> Points, Indices
x_distance_2 = Integer(x_distance)
y_distance_2 = Integer(y_distance)
z_distance_2 = Integer(z_distance)
x_3 = Integer(x_2)
y_3 = Integer(y_2)
z_3 = Integer(z_2)
point = Point(sort_points_2.Points)
integer = Integer(sort_points_2.Indices)
merge_3 = Merge(Data1=x_distance_2, Data2=y_distance_2, Data3=z_distance_2)
merge_4 = Merge(Data1=x_3, Data2=y_3, Data3=z_3)

# ----
# CULL GRID INDICES
indices_to_cull = Slider(0, range=0..10)
point_2 = Point(point)
integer_2 = Integer(integer)
sort_list = SortList(Keys=integer_2)  # -> Keys, ValuesValuesA
series = Series(Start=0, Step=1, Count=indices_to_cull)
cull_index = CullIndex(List=point_2, Indices=series, Wrap=True)
cull_index_2 = CullIndex(List=sort_list.Keys, Indices=series, Wrap=True)

# ----
# FIND CULLED INDICES
original_indices_2 = Integer(sort_points.Indices)
original_points_2 = Point(sort_points.Points)
# SCRIPT FINDS INDICES OF POINTS THAT ARE NOT IN GEOMETRY, NECESSARY FOR NEIGHBORS CALCULATION IN ASTAR ALGORITHM.
building_brep_2 = Brep(cull_pattern)
sort_list_2 = SortList(Keys=original_indices_2)  # -> Keys, ValuesValuesA
breps_face_point_exclusion = BooleanToggle(False)
point_in_breps = PointInBreps(Brep=building_brep_2, Point=original_points_2, Strict=breps_face_point_exclusion)  # -> Inside, Index
cull_pattern_2 = CullPattern(List=sort_list_2.Keys, CullPattern=invert(point_in_breps.Inside))
cull_pattern_3 = CullPattern(List=original_points_2, CullPattern=point_in_breps.Inside)
pointcloud_culled_preview = Point(cull_pattern_3)
cull_data = Integer(cull_pattern_2)

entwine = Entwine(
    Branch00=point_2,
    Branch01=sort_list.Keys,
    Branch02=cull_index_2,
    Branch03=cull_index,
    Branch04=merge_4,
    Branch05=merge_3,
    Branch06=series,
    FlattenInputs=True)  # -> simplify(Result)
cull_pattern_4 = CullPattern(List=sort_list_2.Keys, CullPattern=point_in_breps.Inside)
pointcloud_culled_indices = Integer(cull_pattern_4)
entwine_2 = Entwine(
    Branch00=original_points,
    Branch01=sort_list_2.Keys,
    Branch02=pointcloud_culled_indices,
    Branch03=pointcloud_culled_preview,
    Branch04=grid_extend,
    Branch05=grid_size,
    Branch06=cull_data,
    FlattenInputs=True)  # -> simplify(Result)
data_dam = DataDam(DataDataA=entwine, BufferDelay=10000000, BufferMode=2)
data_dam_2 = DataDam(DataDataA=entwine_2, BufferDelay=10000000, BufferMode=2)

# ----
# BUILDING DATA
explode_tree = ExplodeTree(Data=data_dam_2)  # -> Branch0, Branch1, Branch2, Branch3, Branch4, Branch5, Branch6
pointcloud_culled_preview_2 = Point(explode_tree.Branch3)
original_pointcloud_indices = Integer(explode_tree.Branch1)
pointcloud_culled_indices_2 = Integer(explode_tree.Branch2)
original_pointcloud = Point(explode_tree.Branch0)
grid_extend_2 = Integer(explode_tree.Branch4)
cull_data_2 = Integer(explode_tree.Branch6)
grid_size_2 = Integer(explode_tree.Branch5)

# ----
# GRID DATA
explode_tree_2 = ExplodeTree(Data=data_dam)  # -> Branch0, Branch1, Branch2, Branch3, Branch4, Branch5, Branch6
pointcloud_culled_preview_3 = Point(explode_tree_2.Branch3)
original_pointcloud_indices_2 = Integer(explode_tree_2.Branch1)
pointcloud_culled_indices_3 = Integer(explode_tree_2.Branch2)
original_pointcloud_2 = Point(explode_tree_2.Branch0)
grid_extend_3 = Integer(explode_tree_2.Branch4)
cull_data_3 = Integer(explode_tree_2.Branch6)
grid_size_3 = Integer(explode_tree_2.Branch5)

# ----
# METHOD FILTER
value_list = ValueList({"GRID": 0, "BUILDING": 1}, selected="GRID")
stream_filter = StreamFilter(Gate=value_list, Stream0=original_pointcloud_2, Stream1=original_pointcloud)
stream_filter_2 = StreamFilter(Gate=value_list, Stream0=original_pointcloud_indices_2, Stream1=original_pointcloud_indices)
stream_filter_3 = StreamFilter(Gate=value_list, Stream0=pointcloud_culled_indices_3, Stream1=pointcloud_culled_indices_2)
stream_filter_4 = StreamFilter(Gate=value_list, Stream0=pointcloud_culled_preview_3, Stream1=pointcloud_culled_preview_2)
stream_filter_5 = StreamFilter(Gate=value_list, Stream0=grid_size_3, Stream1=grid_size_2)
stream_filter_6 = StreamFilter(Gate=value_list, Stream0=grid_extend_3, Stream1=grid_extend_2)
stream_filter_7 = StreamFilter(Gate=value_list, Stream0=cull_data_3, Stream1=cull_data_2)
original_pointcloud_indices_3 = Integer(stream_filter_2)
pointcloud_culled_indices_4 = Integer(stream_filter_3)
original_pointcloud_3 = Point(stream_filter)
pointcloud_culled = Point(stream_filter_4)
grid_extend_4 = Integer(stream_filter_6)
cull_data_4 = Integer(stream_filter_7)
grid_size_4 = Integer(stream_filter_5)

startindex = ValueList({"One Start": 0, "Multiple Starts": 1, "Time based": 2, "Closest Point(s)": 3}, selected="One Start")
goalindex = ValueList({"One Goal": 0, "Multiple Goals": 1, "Time based": 2, "Closest point(s)": 3}, selected="One Goal")

# ----
# GENERATE RANDOM START POINTS
list_length = ListLength(List=pointcloud_culled_indices_4)
number_of_values_start_indices = Slider(3, range=0..100)
number_of_values_goal_indices = Slider(10, range=0..100)
construct_domain = ConstructDomain(DomainStart=0, DomainEnd=list_length)
random = Random(Range=construct_domain, Number=number_of_values_goal_indices, Seed=1, Integers=True)
random_2 = Random(Range=construct_domain, Number=number_of_values_start_indices, Seed=0, Integers=True)
start = Number(random_2)
goal = Number(random)

# ----
# TIME BASED START/END POINT
boolean_toggle = BooleanToggle(False)
timer = Timer(Interval=1000, TimerInterval=1000, Target=counter)  # disabled
timer_2 = Timer(Interval=1000, TimerInterval=1000, Target=counter_2)  # disabled
counter = Counter(Reset=boolean_toggle)
counter_2 = Counter(Reset=Toggle(False))
random_3 = Random(Range=construct_domain, Number=1, Seed=counter)
random_4 = Random(Range=construct_domain, Number=1, Seed=counter_2, Integers=True)
start_2 = Integer(random_3)
goal_2 = Integer(random_4)

# ----
# GENERATE RANDOM SEEDS
gene_pool = GenePool(Decimals=0, Maximum=2000, Minimum=0, Value=[1986, 1677, 1756, 952, 2000, 2000, 715, 1242, 1447, 1955])
random_5 = Random(Range=Domain(0, 1000), Number=1, Seed=gene_pool, Integers=True)  # -> flatten(Random)
list_length_2 = ListLength(List=start)
list_length_3 = ListLength(List=goal)
maximum = Maximum(A=list_length_2, B=list_length_3)
repeat_data = RepeatData(Data=random_5, Length=maximum)

# ----
# MANUAL POINT OVERWRITE
goalpoint_s = Point(<point referenced from the Rhino model>)
startpoint_s = Point(<point referenced from the Rhino model>)
closest_point = ClosestPoint(Point=startpoint_s, Cloud=original_pointcloud_3)  # -> ClosestPoint, CPIndex, Distance
closest_point_2 = ClosestPoint(Point=goalpoint_s, Cloud=original_pointcloud_3)  # -> ClosestPoint, CPIndex, Distance

# ----
# POINT/INDEX FINDER
startindex_2 = Slider(613, range=0..1000)
goalindex_2 = Slider(900, range=0..1001)
equality = Equality(FirstNumber=startindex, SecondNumber=3)  # -> Equality, Inequality
equality_2 = Equality(FirstNumber=goalindex, SecondNumber=3)  # -> Equality, Inequality
stream_filter_8 = StreamFilter(Gate=startindex, Stream0=startindex_2, Stream1=start, Stream2=start_2)
stream_filter_9 = StreamFilter(Gate=goalindex, Stream0=goalindex_2, Stream1=goal, Stream2=goal_2)
list_length_4 = ListLength(List=pointcloud_culled)
longest_list = LongestList(ListListA=stream_filter_8, ListListB=list_length_4, PaddingMode=2)  # -> ListListA, ListListB
longest_list_2 = LongestList(ListListA=stream_filter_9, ListListB=list_length_4, PaddingMode=2)  # -> ListListA, ListListB
modulus = Modulus(A=longest_list_2.ListListA, B=longest_list_2.ListListB)
modulus_2 = Modulus(A=longest_list.ListListA, B=longest_list.ListListB)
list_item_2 = ListItem(List=pointcloud_culled_indices_4, Index=modulus_2, Wrap=True)
list_item_3 = ListItem(List=pointcloud_culled_indices_4, Index=modulus, Wrap=True)
list_item_4 = ListItem(List=original_pointcloud_3, Index=list_item_2, Wrap=True)
list_item_5 = ListItem(List=original_pointcloud_3, Index=list_item_3, Wrap=True)
stream_filter_10 = StreamFilter(Gate=equality.Equality, Stream0=list_item_4, Stream1=closest_point.ClosestPoint)
stream_filter_11 = StreamFilter(Gate=equality.Equality, Stream0=list_item_2, Stream1=closest_point.CPIndex)
stream_filter_12 = StreamFilter(Gate=equality_2.Equality, Stream0=list_item_3, Stream1=closest_point_2.CPIndex)
stream_filter_13 = StreamFilter(Gate=equality.Equality, Stream0=list_item_5, Stream1=closest_point_2.ClosestPoint)
start_indices = Integer(stream_filter_11)
goal_indices = Integer(stream_filter_12)
goal_points = Point(stream_filter_13)
start_points = Point(stream_filter_10)

# ----
# If parallel is True, results will not be calculated in the same order and therefore will not always be the same.
parallel = BooleanToggle(True)

value_list_2 = ValueList({"Rectangular": 0, "Diagonal": 1, "Corners": 2}, selected="Diagonal")
manhattandistance = BooleanToggle(True)
list_item_6 = ListItem(List=grid_size_4, Index=0, Wrap=True)  # -> Item, Item1, Item2
list_item_7 = ListItem(List=grid_extend_4, Index=0, Wrap=True)  # -> Item, Item1, Item2
x_distance_3 = Integer(list_item_6.Item)
y_4 = Integer(list_item_7.Item1)
y_distance_3 = Integer(list_item_6.Item1)
z_distance_3 = Integer(list_item_6.Item2)
x_4 = Integer(list_item_7.Item)
z_4 = Integer(list_item_7.Item2)
astar_algorithm_fast = GhPythonScript(
    x_dis=x_distance_3,
    y_dis=y_distance_3,
    z_dis=z_distance_3,
    x=x_4,
    y=y_4,
    z=z_4,
    StartIndex=start_indices,
    GoalIndex=goal_indices,
    Seeds=repeat_data,
    Cull_Data=cull_data_4,
    Type=value_list_2,
    manhattanDistance=manhattandistance,
    Parallel=parallel)  # -> result; inputs x: Int32, y: Int32, z: Int32, StartIndex: list of Int32, GoalIndex: list of Int32, Seeds: list of Int32, Cull_Data: list of Int32, manhattanDistance: Boolean, Parallel: Boolean
# ---------- astar_algorithm_fast: Python ----------
__author__copy = "Job de Vogel"
__version__ = "2020.11.06"

from math import sqrt
import array as array
import random

#Grasshopper to Python variables:
cloud_size = x * y * z
StartIndex = StartIndex
GoalIndex = GoalIndex

#Initialize neigbor relations, will be altered on the basis of GH input
rectangular = False
diagonal = False
corners = False

#This variable stores previously calculated neighbors, so that they don't have to be calculated multiple times
neighbor_storage = {}

#if index higher than cloud_size, replace the index
for i in range(len(StartIndex)):
    if StartIndex[i] >= cloud_size:
        StartIndex[i] %= cloud_size

for j in range(len(GoalIndex)):
    if GoalIndex[j] >= cloud_size:
        GoalIndex[j] %= cloud_size

#Check which list is longer: list with StartIndices or list with GoalIndices
if not Parallel:
    longest_list = max(StartIndex, GoalIndex, key=len)

###grasshopper variables
if Type == 0:
    rectangular = True
elif Type == 1:
    rectangular = True
    diagonal = True
elif Type == 2:
    rectangular = True
    diagonal = True
    corners = True

def pythagoras(x, y, z = 0):
    return sqrt(x**2 + y**2 + z**2)

def manhattan(index_1, index_2):
    x_manhattan = abs(((index_2 // (y * z)) - (index_1 // (y * z)))) * x_dis
    y_manhattan = abs(((index_2 % (y * z)) // z) - ((index_1 % (y * z)) // z)) * y_dis
    z_manhattan = abs((index_2 % z - index_1 % z)) * z_dis
    return x_manhattan + y_manhattan + z_manhattan

def euclidian(index_1, index_2):
    x_manhattan = abs(((index_2 // (y * z)) - (index_1 // (y * z)))) * x_dis
    y_manhattan = abs(((index_2 % (y * z)) // z) - ((index_1 % (y * z)) // z)) * y_dis
    z_manhattan = abs((index_2 % z - index_1 % z)) * z_dis
    return sqrt(x_manhattan**2 + y_manhattan**2 + z_manhattan**2)

#If diagonal: calculate the diagonal distances
if diagonal:
    xy_dis = pythagoras(x_dis, y_dis)
    xz_dis = pythagoras(x_dis, z_dis)
    yz_dis = pythagoras(y_dis, z_dis)  

#If corners: calculate the corner distances
if corners:
    t_dis = pythagoras(x_dis, y_dis, z_dis)

for i in range(len(StartIndex)):
    if StartIndex[i] >= cloud_size:
        StartIndex[i] %= cloud_size

for j in range(len(GoalIndex)):
    if GoalIndex[j] >= cloud_size:
        GoalIndex[j] %= cloud_size

def neighbors(i):
    nb = {}
    bottum = top = left = right = front = back = False 

    if i % z == 0: 
        bottum = True # --> [i - 1]
    if i % z == z - 1: 
        top = True #top --> [i + 1]
    if i < (y * z): 
        left = True #left --> [i - (y * z)]
    if i >= (cloud_size - (y * z)): 
        right = True #right --> [i + (y * z)]
    if ((i % (y * z)) < z): 
        front = True # front --> [i - z]]
    if ((i % (y * z)) >= (y * z) - z): 
        back = True # back

    #if in center:
    if (bottum == top == left == right == front == back == False):
        if rectangular:
            #nb_indices: the indices of all possible neighbors of a node
            #distances: the distances to each possible neighbor in order of nb_indices
            nb_indices = array.array('i', [i - (y * z), i + (y * z), i - z, i + z, i - 1, i + 1])
            distances = array.array('f', [x_dis, x_dis, y_dis, y_dis, z_dis, z_dis])

            #for each possible neighbor, if not in Cull_Data, add it to the final neighbors with the correct distance
            for j in range(len(nb_indices)):
                if nb_indices[j] not in Cull_Data:
                    nb[nb_indices[j]] = distances[j]

        if diagonal:
            #nb_indices: the indices of all possible neighbors of a node
            #distances: the distances to each possible neighbor in order of nb_indices
            nb_indices = array.array('i', [i - (y * z) - 1, i + (y * z) - 1, i - z - 1, i + z - 1, i - (y * z) + 1, i + (y * z) + 1, i - z + 1, i + z + 1, i - (y * z) - z, i - (y * z) + z, i + (y * z) - z, i + (y * z) + z])
            distances = array.array('f', [xz_dis, xz_dis, yz_dis, yz_dis, xz_dis, xz_dis, yz_dis, yz_dis, xy_dis, xy_dis, xy_dis, xy_dis])
            
            #for each possible neighbor, if not in Cull_Data, add it to the final neighbors with the correct distance
            for j in range(len(nb_indices)):
                if nb_indices[j] not in Cull_Data:
                    nb[nb_indices[j]] = distances[j]
        if corners:
            #nb_indices: the indices of all possible neighbors of a node
            nb_indices = array.array('i', [i + (y * z) + z + 1, i + (y * z) + z - 1, i + (y * z) - z + 1, i + (y * z) - z - 1, i + (y * z) - z - 1, i - (y * z) + z - 1, i - (y * z) - z + 1, i - (y * z) - z - 1])
            #for each possible neighbor, if not in Cull_Data, add it to the final neighbors with the correct distance
            for j in range(len(nb_indices)):
                if nb_indices[j] not in Cull_Data:
                    nb[nb_indices[j]] = t_dis
    #if not in center, check on which edges:
    else:
        if rectangular:
            #nb_indices: the indices of all possible neighbors of a node
            #distances: the distances to each possible neighbor in order of nb_indices
            #edges: edge to check for every neigbor, if neighbor not on that edge, add the neighbor to the node
            nb_indices = array.array('i', [i - (y * z), i + (y * z), i - z, i + z, i - 1, i + 1])
            distances = array.array('f', [x_dis, x_dis, y_dis, y_dis, z_dis, z_dis])
            edges = [left, right, front, back, bottum, top]

            #for each possible neighbor, if not in Cull_Data, add it to the final neighbors with the correct distance
            for j in range(len(nb_indices)):
                if nb_indices[j] not in Cull_Data and not edges[j]:
                    nb[nb_indices[j]] = distances[j]

        if diagonal:
            #nb_indices: the indices of all possible neighbors of a node
            #distances: the distances to each possible neighbor in order of nb_indices
            #edges: edge to check for every neigbor, if neighbor not on that edge, add the neighbor to the node
            nb_indices = array.array('i', [i - (y * z) - 1, i + (y * z) - 1, i - z - 1, i + z - 1, i - (y * z) + 1, i + (y * z) + 1, i - z + 1, i + z + 1, i - (y * z) - z, i - (y * z) + z, i + (y * z) - z, i + (y * z) + z])
            distances = array.array('f', [xz_dis, xz_dis, yz_dis, yz_dis, xz_dis, xz_dis, yz_dis, yz_dis, xy_dis, xy_dis, xy_dis, xy_dis])
            edges = [bottum|left, bottum|right, bottum|front, bottum|back, top|left, top|right, top|front, top|back, left|front, left|back, right|front, right|back]
            #for each possible neighbor, if not in Cull_Data, add it to the final neighbors with the correct distance
            for j in range(len(nb_indices)):
                if nb_indices[j] not in Cull_Data and not edges[j]:
                    nb[nb_indices[j]] = distances[j]

        if corners:
            #nb_indices: the indices of all possible neighbors of a node
            #edges: edge to check for every neigbor, if neighbor not on that edge, add the neighbor to the node
            nb_indices = array.array('i', [i + (y * z) + z + 1, i + (y * z) + z - 1, i + (y * z) - z + 1, i + (y * z) - z - 1, i - (y * z) + z + 1, i - (y * z) + z - 1, i - (y * z) - z + 1, i - (y * z) - z - 1])
            edges = [top|right|back, bottum|right|back, top|right|front, bottum|right|front, top|left|back, bottum|left|back, top|left|front, bottum|left|front]
            #for each possible neighbor, if not in Cull_Data, add it to the final neighbors with the correct distance
            for j in range(len(nb_indices)):
                if nb_indices[j] not in Cull_Data and not edges[j]:
                    nb[nb_indices[j]] = t_dis
    return nb

def algorithm(Start, Goal, manhattanDistance = True):
    ###variables:
    open_set = []
    open_set.append((0, Start))
    came_from = {}
    path = array.array('i', [])
    
    #Generate a seed, based on Seeds input and StartIndex-Index
    if not Parallel:
        if longest_list == StartIndex:
            num = Start
        else:
            num = Goal
    
        random.seed(Seeds[longest_list.index(num)])
        seed = random.sample(range(cloud_size), cloud_size)

    g_score = {index: float("inf") for index in range(cloud_size)}
    g_score[Start] = 0

    f_score = {index: float("inf") for index in range(cloud_size)}

    if manhattanDistance:
        f_score[Start] = manhattan(Start, Goal)
    else:
        f_score[Start] = euclidian(Start, Goal)

    closed_set = {Start}

    iterations = 1

    #Algorithm function:
    while open_set:
        current = open_set[0][1]
        closed_set.remove(current)

        if current == Goal:
            #rebuild the path:
            while current != Start:
                    try:
                        path.insert(0, current)
                        current = came_from[current]
                    except KeyError:
                        path = False
                        break
            path.insert(0, Start)
            break

        #f_score_temp stores the f_scores of the neighbors of this node, so that it can be shuffled before it is added to the open_set
        f_score_temp = []
        #check if the neighbors of this node have been calculated previously. If yes, retrieve from storage, if no, calculate it here
        if current in neighbor_storage:
            Neighbors = neighbor_storage[current]
        else:
            Neighbors = neighbors(current)
            neighbor_storage[current] = Neighbors

        #Calculate f_score for all neighbors
        for neighbor in Neighbors:
            temp_g_score = g_score[current] + Neighbors[neighbor]
            if temp_g_score < g_score[neighbor]:
                came_from[neighbor] = current
                g_score[neighbor] = temp_g_score
                
                if manhattanDistance:
                    f_score[neighbor] = temp_g_score + manhattan(neighbor, Goal)
                else:
                    f_score[neighbor] = temp_g_score + euclidian(neighbor, Goal) 

                if neighbor not in closed_set:
                    f_score_temp.append((f_score[neighbor], neighbor))
                    closed_set.add(neighbor)

        #shuffle the neighors and their f_scores (this will give alternative paths)
        if not Parallel:
            random.seed(seed[current])
        random.shuffle(f_score_temp)
       
        open_set = open_set + f_score_temp
        
        #sort open_set based on f_score
        open_set.pop(0)
        open_set = sorted(open_set, key = lambda f: f[0])
        iterations += 1
    print(iterations)
    return path

def main(i):
    #Check if there are multiple starts/goals, if not use a single value
    if len(StartIndex) > 1:
        Start = StartIndex[i]
    else:
        Start = StartIndex[0]

    if len(GoalIndex) > 1:
        Goal = GoalIndex[i]
    else:
        Goal = GoalIndex[0]
    
    #In fast version of Astar, Start automatically gets added withoud checking Cull_Data, therefore do it manually here
    if Start in Cull_Data:
        Start = None

    #If goal isn't checked in Cull_Data, it is calculated, while a path is not possible
    if Goal in Cull_Data:
        Goal = None

    #Try to find a path, if not possible, return empty list
    try:
        path = algorithm(Start, Goal, manhattanDistance)
    except:
        path = None
    return path

#Find the number of paths to find
number_of_paths = [j for j in range(max(len(StartIndex), len(GoalIndex)))]

import ghpythonlib.parallel as parallel
import ghpythonlib.treehelpers as th

#ADD A NON-PARALLEL OPTION HERE
if Parallel == True:
    result = th.list_to_tree(parallel.run(main, number_of_paths, False))
else:
    result = []
    for i in number_of_paths:
        result.append(main(i))
    result = th.list_to_tree(result)
# ---------- end astar_algorithm_fast ----------

# ----
# VISUALIZATION START/GOAL
list_item_8 = ListItem(List=grid_size_4, Index=0, Wrap=True)  # -> Item, Item1, Item2
center_box_3 = CenterBox(
    Base=PlaneXY(0, 0, 0),
    X=expr("x/2", list_item_8.Item),
    Y=expr("x/2", list_item_8.Item1),
    Z=expr("x/2", list_item_8.Item2))
move = Move(Geometry=center_box_3, Motion=start_points)  # -> Geometry, Transform
move_2 = Move(Geometry=center_box_3, Motion=goal_points)  # -> Geometry, Transform

mesh_brep = MeshBrep(
    Brep=move.Geometry,
    Settings={GridMaxCount=0, GridMinCount=16, JaggedSeams=False, MaxEdgeLength=0, MinEdgeLength=0.0001, MinTolerance=0, Refine=True, RefineAngle=0, RelativeTolerance=0.65, SimplePlanes=True, Tolerance=0})
mesh_brep_2 = MeshBrep(
    Brep=move_2.Geometry,
    Settings={GridMaxCount=0, GridMinCount=16, JaggedSeams=False, MaxEdgeLength=0, MinEdgeLength=0.0001, MinTolerance=0, Refine=True, RefineAngle=0, RelativeTolerance=0.65, SimplePlanes=True, Tolerance=0})

custom_preview_2 = CustomPreview(Geometry=mesh_brep, Material=ColourSwatch(SwatchColor=RGB(92, 204, 27)))
custom_preview_3 = CustomPreview(Geometry=mesh_brep_2, Material=ColourSwatch(SwatchColor=RGB(242, 70, 70)))

# ----
# PATH VISUALIZATION
original_point_cloud = Point(original_pointcloud_3)
list_item_9 = ListItem(List=original_point_cloud, Index=astar_algorithm_fast, Wrap=True)  # -> simplify(Item)
prune_tree = PruneTree(Tree=list_item_9, Minimum=2, Maximum=0)
polyline = PolyLine(Vertices=prune_tree, Closed=False)
length = Length(Curve=polyline)  # -> flatten(Length)
mass_addition = MassAddition(Input=length)  # -> Result, PartialResults
number_4 = Number(mass_addition.Result)
total_curve_length = Panel(number_4)
pipe_thickness = Slider(0.1, range=0..0.1)
create_material = CreateMaterial(
    Diffuse=ColourSwatch(SwatchColor=RGB(104, 127, 242)),
    Specular=RGB(255, 255, 255),
    Emission=RGB(0, 0, 0),
    Transparency=0,
    Shine=0)

# ----
# ANIMATOR
number_slider_3 = Slider(1, range=0.001..1)
shatter = Shatter(Curve=reparameterize(simplify(polyline)), Parameters=number_slider_3)
list_item_10 = ListItem(List=shatter, Index=1, Wrap=True)

pipe = Pipe(Curve=list_item_10, Radius=pipe_thickness, Caps=2)

mesh_brep_3 = MeshBrep(
    Brep=pipe,
    Settings={GridMaxCount=0, GridMinCount=16, JaggedSeams=False, MaxEdgeLength=0, MinEdgeLength=0.0001, MinTolerance=0, Refine=True, RefineAngle=0, RelativeTolerance=0.65, SimplePlanes=True, Tolerance=0})

custom_preview_4 = CustomPreview(Geometry=mesh_brep_3, Material=create_material)
