# Grasshopper definition Astar_raw.gh (Grasshopper 1.0.7)
# Copyright: Job de Vogel

start_1 = Slider(1, range=0..10)
manhattandistance = BooleanToggle(True)
manhattandistance_2 = BooleanToggle(False)
start_2 = Slider(2, range=0..10)
goal = Slider(5, range=0..10)
point = Point([Point(-47, -29, 0), Point(-37, -19, 0), Point(-35, -25, 0), Point(-44, -36, 0), Point(-42, -41, 0), Point(-58, -21, 0)])
astar_algorithm_fast = GhPythonScript(
    Nodes=point,
    StartIndex=[start_1, start_2],
    GoalIndex=goal,
    manhattanDistance=manhattandistance,
    Parallel=manhattandistance_2)  # -> out, Result; inputs Nodes: list, StartIndex: list of Int32, GoalIndex: list of Int32, Seeds: list of Int32, Parallel: Boolean
# ---------- astar_algorithm_fast: Python ----------
"""Provides a scripting component.
    Inputs:
        Data: Data about map, grid or network, which is used in the TO DO part, line 37.
        Nodes: List of points with indicating all points in the network.
        StartIndex: List of or single integer indicating the start index nodes.
        GoalIndex: List of or single integer indicating the goal index nodes.
        Seeds: (Optional) If multiple paths are shortest, change seed value for each path to get different result.
        Parallel: True if script should run shortest paths in parallel.
    Output:
        Result: Node indices that are included in the shortest path."""

__author__copy = "Job de Vogel"
__version__ = "2022.10.05"

from math import sqrt
import array as array
import random
import ghpythonlib.parallel as parallel
import ghpythonlib.treehelpers as th

""" A STAR
This algorithm finds the shortest path between one, or multiple nodes.
The input of the StartIndex and GoalIndex can be a single integer index
or a list of indices. It is possible to calculate the result in parallel.

If only one StartIndex is provided, and a list of GoalIndices, it is assumed
that you want to find the shortest path between that single start to all
goals.
"""

#Grasshopper to Python variables:
StartIndex = StartIndex
GoalIndex = GoalIndex

# This variable stores the neighbors of each node, and the weights
# Format: {1: {2: 512.01, 3: 609.02, 4: 95.3}, 2: { ... }, 3: { ... }}
# Which means: Node 1 has a connection to node 2, 3 and 4
# with weight 512.01, 609.02 and 95.3 respectively
neighbor_storage = {}
cloud_size = len(neighbor_storage)

""" TO DO
Currently, the algorithm does not have information about the neighbours,
meaning: if you have a map with nodes and edges, the algorithm should
know the neighbours of each node, and the weight (length) of its edges.

Here you have to define that. It could be based on a network of lines,
from OSM for example, or just a pointcloud. There are many options.

Make sure that the output results in a variable called neighbor_storage
containing all data as descriped in the format above.
"""

# EXAMPLE:
neighbor_storage = {0: {1: 50, 2: 20, 3: 30, 4: 40}, 1: {0: 50, 2: 20, 3: 30}, 2: {1: 10, 3: 25}, 3: {2: 10, 4: 5}, 4: {3: 10, 5: 8}, 5: {3: 3, 4: 10}}
cloud_size = len(neighbor_storage)

#Check which list is longer: list with StartIndices or list with GoalIndices
if not Parallel:
    longest_list = max(StartIndex, GoalIndex, key=len)

def manhattan(node_1, node_2):
    x_dif = abs(node_1[0] - node_2[0])
    y_dif = abs(node_1[1] - node_2[1])
    z_dif = abs(node_1[2] - node_2[2])
    return x_dif + y_dif + z_dif

def euclidian(node_1, node_2):
    x_dif = abs(node_1[0] - node_2[0])
    y_dif = abs(node_1[1] - node_2[1])
    z_dif = abs(node_1[2] - node_2[2])
    return sqrt(x_dif**2 + y_dif**2 + z_dif**2)

def algorithm(Start, Goal, manhattanDistance = True):
    ###variables:
    open_set = []
    open_set.append((0, Start))
    came_from = {}
    path = array.array('i', [])
    
    #Generate a seed, based on Seeds input and StartIndex-Index
    if not Parallel:
        if longest_list == StartIndex:
            num = Start
        else:
            num = Goal
        
        if Seeds:
            random.seed(Seeds[longest_list.index(num)])
            seed = random.sample(range(cloud_size), cloud_size)

    g_score = {index: float("inf") for index in range(cloud_size)}
    g_score[Start] = 0

    f_score = {index: float("inf") for index in range(cloud_size)}

    if manhattanDistance:
        f_score[Start] = manhattan(Nodes[Start], Nodes[Goal])
    else:
        f_score[Start] = euclidian(Nodes[Start], Nodes[Goal])

    closed_set = {Start}

    iterations = 1

    #Algorithm function:
    while open_set:
        current = open_set[0][1]
        closed_set.remove(current)

        if current == Goal:
            #rebuild the path:
            while current != Start:
                    try:
                        path.insert(0, current)
                        current = came_from[current]
                    except KeyError:
                        path = False
                        break
            path.insert(0, Start)
            break

        #f_score_temp stores the f_scores of the neighbors of this node, so that it can be shuffled before it is added to the open_set
        f_score_temp = []
        # Find the neighbours and weights of the current node
        Neighbors = neighbor_storage[current]

        #Calculate f_score for all neighbors
        for neighbor in Neighbors:
            temp_g_score = g_score[current] + Neighbors[neighbor]
            if temp_g_score < g_score[neighbor]:
                came_from[neighbor] = current
                g_score[neighbor] = temp_g_score
                
                if manhattanDistance:
                    f_score[neighbor] = temp_g_score + manhattan(Nodes[neighbor], Nodes[Goal])
                else:
                    f_score[neighbor] = temp_g_score + euclidian(Nodes[neighbor], Nodes[Goal]) 

                if neighbor not in closed_set:
                    f_score_temp.append((f_score[neighbor], neighbor))
                    closed_set.add(neighbor)

        #shuffle the neighors and their f_scores (this will give alternative paths)
        if not Parallel:
            if Seeds:
                random.seed(seed[current])
        
        if Seeds:
            random.shuffle(f_score_temp)
       
        open_set = open_set + f_score_temp
        
        #sort open_set based on f_score
        open_set.pop(0)
        open_set = sorted(open_set, key = lambda f: f[0])
        iterations += 1
    return path

def main(i):
    #Check if there are multiple starts/goals, if not use a single value
    if len(StartIndex) > 1:
        Start = StartIndex[i]
    else:
        Start = StartIndex[0]

    if len(GoalIndex) > 1:
        Goal = GoalIndex[i]
    else:
        Goal = GoalIndex[0]

    #Try to find a path, if not possible, return empty list
    try:
        path = algorithm(Start, Goal, manhattanDistance)
    except:
        path = None
        print('[USERWARNING] No path could be found between {} and {}.'.format(Start, Goal))
    return path

if __name__ == '__main__':
    #Find the number of paths to find
    number_of_paths = [j for j in range(max(len(StartIndex), len(GoalIndex)))]
    
    #ADD A NON-PARALLEL OPTION HERE
    if Parallel == True:
        Result = th.list_to_tree(parallel.run(main, number_of_paths, False))
    else:
        Result = []
        for i in number_of_paths:
            Result.append(main(i))
        Result = th.list_to_tree(Result)
    print('[INFO] Finished shortest path computation.')
# ---------- end astar_algorithm_fast ----------
panel = Panel(astar_algorithm_fast.out)
panel_2 = Panel(astar_algorithm_fast.Result)
